# Grasshopper definition moving blocks to assign layer.gh (Grasshopper 1.0.7)

# ---- group: 2
toggle = BooleanToggle(False)

# ---- group: 1
toggle_2 = BooleanToggle(False)

# ----
python = GhPythonScript(update=toggle_2)  # -> out, currentlayers; inputs update: Boolean
# ---------- python: Python ----------
__author__ = "PrepArch#004"
__version__ = "2020.01.08"

import rhinoscriptsyntax as rs
import scriptcontext as sc
import Rhino

sc.doc = Rhino.RhinoDoc.ActiveDoc

if update:
    layers = rs.LayerNames(True)
    currentlayers = layers
    
sc.doc = ghdoc
# ---------- end python ----------
item = ListItem(List=python.currentlayers, Index=Slider(2, range=0..10), Wrap=True)
item_2 = ListItem(List=python.currentlayers, Index=Slider(3, range=0..10), Wrap=True)
python_2 = GhPythonScript(clean=toggle, layer=item_2, blklayer=item)  # -> out, blocks
# ---------- python_2: Python ----------
__author__ = "PrepArch#004"
__version__ = "2019.11.04"

import rhinoscriptsyntax as rs
import scriptcontext as sc
import Rhino



def MoveBlockObjectsToLayer():

    ids = rs.BlockInstances(blk,0) #assign the block that want to modify
    if not ids:
        return
    targ = rs.LayerId(layer) #assign the layer that want to change to 
    if not targ:
        return
    
    names = list(set([rs.BlockInstanceName(id) for id in ids])) #set method to remove the duplicate instances(ID)
    done = []


    def BlockDrill(names):
        while True:
            if len (names) > 0 :
                name = names.pop() 
            else: break
            
            done.append(name)
            temp = rs.BlockObjects(name) #Returns identifiers of the objects that make up a block definition
            rs.ObjectLayer(temp, targ)
            
            # if there r nested block
            for tempId in temp:
                if rs.IsBlockInstance(tempId):
                    tempName = rs.BlockInstanceName(tempId)
                    if tempName not in names and tempName not in done:
                        names.append(tempName)
                        BlockDrill(names)
            
    BlockDrill(names)
    

if clean:
    sc.doc =Rhino.RhinoDoc.ActiveDoc
    blks = rs.BlockNames()
    for blk in blks:
        
        MoveBlockObjectsToLayer()
        rs.ObjectLayer(rs.BlockInstances(blk), blklayer)
        
    blocks = blks
    sc.doc = ghdoc
# ---------- end python_2 ----------
current_blocks_in_doc = Panel(python_2.blocks)
currentlayers = Panel(python.currentlayers)
