# Grasshopper definition unroll_mesh.gh (Grasshopper 1.0.7)

# BY Yuchen
# www.yuccheno.com
python = GhPythonScript()  # -> out, a; inputs mesh: tree of Mesh
# ---------- python: Python ----------
__author__ = "YU"
__version__ = "2019.07.30"

import rhinoscriptsyntax as rs
import Rhino.Geometry as rg
import Grasshopper as gh
import Grasshopper.Kernel.Data as gkd


pathnum = mesh.BranchCount
breptree = gh.DataTree[object]()

#access the branches
for i in range(pathnum):
    meshlist = mesh.Branch(i)
    breplist = []
#access the items
    for m in meshlist:
        brep2mesh = rg.Brep.CreateFromMesh(m, True)
        unroller = rg.Unroller(brep2mesh)
        unroll_brep = rg.Unroller.PerformUnroll(unroller)

        brep = unroll_brep[0][0] # output of perform unroll is 2d array
        breplist.append(brep)
    
    breptree.AddRange(breplist, mesh.Path(i)) #addrange for adding list in datatree
a = breptree
# ---------- end python ----------
