# Grasshopper definition unroll_mesh2.gh (Grasshopper 1.0.7)
# plug-ins: MeshEdit Components

# written by Yuchen Chen
# www.yuccheno.com
msphere = MeshSphere(Base=PlaneXY(0, 0, 0), Radius=10, UCount=10, VCount=Slider(5, range=0..10))
explode = MeshExplode(Mesh=msphere, Interpolate=False)
number_slider = Slider(10, range=0..10)
partition = PartitionList(List=explode, Size=Slider(9, range=0..10))
# the output arrangement is according to the tree structure of the input mesh
python = GhPythonScript(mesh=partition, x_dis=Slider(12, range=0..100), y_dis=Slider(12, range=0..100))  # -> out, output_geo, output_center; inputs mesh: tree of Mesh, x_dis: Int32, y_dis: Int32
# ---------- python: Python ----------
__author__ = "YU"
__version__ = "2019.07.30"

import rhinoscriptsyntax as rs
import Rhino.Geometry as rg
import Grasshopper as gh
import Grasshopper.Kernel.Data as gkd

def pt2plane(pts_tree):
    planes_tree = gh.DataTree[object]()
    branchnum = pts_tree.BranchCount
    for i in range(branchnum):
        pts_list = pts_tree.Branch(i)
        planes_list = []
        for pt in pts_list:
            planes_list.append(rg.Plane(pt, rg.Vector3d(0,0,01)))
        
        planes_tree.AddRange(planes_list, pts_tree.Path(i))
    return planes_tree

pathnum = mesh.BranchCount

breptree = gh.DataTree[object]()
center_of_breptree = gh.DataTree[object]() 
points_tree = gh.DataTree[object]()

#unroll mesh and get the center pt to prepare for moving

#access the branches
for i in range(pathnum):
    meshlist = mesh.Branch(i)
    breplist = []
    center_of_breplist = []
#access the items
    for m in meshlist:
        brep2mesh = rg.Brep.CreateFromMesh(m, True)
        unroller = rg.Unroller(brep2mesh)
        unroll_brep = rg.Unroller.PerformUnroll(unroller)
        brep = unroll_brep[0][0] # output of perform unroll is 2d array
        brep_areaprop = rg.AreaMassProperties.Compute(brep)
        center_of_brep = rg.AreaMassProperties.Centroid.GetValue(brep_areaprop)
        breplist.append(brep)
        center_of_breplist.append(center_of_brep)
        
    
    breptree.AddRange(breplist, mesh.Path(i)) #addrange for adding list in datatree
    center_of_breptree.AddRange( center_of_breplist, mesh.Path(i))

#create the target plane based on the branch count

for i in range(pathnum):
    breps = breptree.Branch(i)
    points_list = []
    for j in range(len(breps)):
        point = rg.Point3d(i*x_dis, j*y_dis,0)
        points_list.append(point)
    
    points_tree.AddRange(points_list, mesh.Path(i))


tar_planes = pt2plane(points_tree)
org_planes = pt2plane(center_of_breptree)

#move the surface to target

for i in range(pathnum):
    breps = breptree.Branch(i)
    org_plane = org_planes.Branch(i)
    tar_plane = tar_planes.Branch(i)
    for j, element in enumerate(breps):
        trans = rg.Transform.PlaneToPlane(org_plane[j], tar_plane[j])
        breps[j].Transform(trans)
        

output_geo = breptree
output_center = points_tree
# ---------- end python ----------
tstat = TreeStatistics(Tree=python.output_geo)  # -> Paths, Length, Count
crv = Curve(python.output_geo)
series = Series(Start=0, Step=1, Count=tstat.Length)
concat = Concatenate(FragmentA=graft(tstat.Paths), FragmentB=series)
panel = Panel(concat)
tag = TextTag(Location=python.output_center, Text=concat)
